# Dynamo graph Join_by_category_v3_WebRequest.dyn (Dynamo 1.3.4.6666)

forceChildrensEval = ForceChildrensEval()  # unwired: arg0
webRequestGitHab = Python(IN[0]=forceChildrensEval)
# ---------- webRequestGitHab.python (59 lines) ----------
# -*- coding: utf-8 -*- 
#-----------------------Импоорт библиотек----------------------
import clr
import sys 
sys.path.append("C:\Program Files (x86)\IronPython 2.7\Lib")
import os
#import gitlab

import System
from System import Guid
from System import DateTime
from System.IO import StreamReader
from System.Net import WebRequest, HttpRequestHeader
clr.AddReference('System.Web.Extensions')
from System.Web.Script.Serialization import JavaScriptSerializer 

from System import Type, Activator, IO, Text, Uri, Convert
#Excel = Activator.CreateInstance(Type.GetTypeFromProgID("Excel.Application"))

file_path = 'C:\\temp\\githab_code.py'

#-----------------------ФУНКЦИИ----------------------
def flatten(container):
	for i in container:
		if isinstance(i, (list,tuple)):
			for j in flatten(i):
				yield j
		else:
			yield i

def LogSaveStrList(string_list):
	IO.File.AppendAllLines(file_path, flatten(string_list), Text.Encoding.Unicode)

def LogSaveStr(string):
	IO.File.WriteAllText(file_path, string, Text.Encoding.Unicode)
	

def rsnrequest():
	request = WebRequest.Create('https://api.github.com/repos/Babinoff/Join_Unjoin/contents/Join_by_category_main.py?ref=master')
	request.Method = "GET"
	request.UserAgent = "Anything"
	#request.ServicePoint.Expect100Continue = False
	token = '2f4c54160568dad4f3cd002ab358d9bf935ef133'
	#request.Headers.Add(HttpRequestHeader.Authorization, token)
	request.Headers["OAUTH-TOKEN"] = token
	rsp = request.GetResponse()
	stream_reader = StreamReader(rsp.GetResponseStream())
	jsonData = stream_reader.ReadToEnd()
	stream_reader.Close()
	json = JavaScriptSerializer().DeserializeObject(jsonData)
	return json
	
json_recv = rsnrequest()
data_from_json = json_recv["content"]
base64EncodedBytes = System.Convert.FromBase64String(data_from_json)
python_code_string = System.Text.Encoding.UTF8.GetString(base64EncodedBytes)
LogSaveStr(python_code_string)

OUT = python_code_string
# ----------------------------------------
список_категорий = StringInput("Части, Стены, Перекрытия, Несущие колонны, Каркас несущий")
объединить_геометрию_разделить = BoolSelector(true)  # "Объединить геометрию /// Разделить геометрию"
python_script_from_string = PythonStringNode(script=webRequestGitHab, IN[0]=список_категорий, IN[1]=объединить_геометрию_разделить)
get_link_elem_refs_and_recreate = Python()  # "get link elem. refs. and recreate its"; frozen; unwired: IN[0], IN[1], IN[2], IN[3], IN[4]
# ---------- get_link_elem_refs_and_recreate.python (365 lines) ----------
import sys 
sys.path.append("C:\Program Files (x86)\IronPython 2.7\Lib")
from itertools import repeat
import gc
import string
import ctypes
import traceback

import clr
clr.AddReference("RevitAPIUI")
from Autodesk.Revit.UI import Selection
from Autodesk.Revit.UI.Selection import ISelectionFilter

clr.AddReference("RevitServices")
from RevitServices.Persistence import DocumentManager
from RevitServices.Transactions import TransactionManager
clr.AddReference('RevitAPI')
from Autodesk.Revit.DB import *#Options, PartUtils, LinkElementId, IFamilyLoadOptions, ElementId, UnitType, UnitUtils, XYZ, IDuplicateTypeNamesHandler, SaveAsOptions
from Autodesk.Revit.DB.Structure import StructuralType

clr.AddReference('System')
import System
from System.Collections.Generic import List
from System.Diagnostics import Process
from System import Math

#clr.AddReference('RevitAPI')
#from Autodesk.Revit.DB import *#

clr.AddReference('ProtoGeometry')
import Autodesk
from Autodesk.DesignScript.Geometry import *
from Autodesk.DesignScript.Geometry import Point as DynPoint

class iDuplicatesOptoins(IDuplicateTypeNamesHandler):
	def OnDuplicateTypeNamesFound(self,duplicate_type_arg):
		return DuplicateTypeAction.UseDestinationTypes	

#region получаем Референсы элементов связаных файлов
geo_options = Options()
geo_options.ComputeReferences = True
geo_options.IncludeNonVisibleObjects = True
doc = DocumentManager.Instance.CurrentDBDocument
uidoc = DocumentManager.Instance.CurrentUIApplication.ActiveUIDocument

def tolist(obj1):
	if hasattr(obj1,"__iter__"): return obj1
	else: return [obj1]

class CustomISelectionFilterList(ISelectionFilter):
	def __init__(self, link_doc, fail_cats_list, fail_types_list, all_link_id_string):
		self.link_doc = link_doc
		self.fail_cats_list = fail_cats_list
		self.fail_types_list = fail_types_list
		self.all_link_id_string = all_link_id_string
	def AllowElement(self, e):
		if e.Category.Name in self.fail_cats_list:
			return False
		else:
			return True
	def AllowReference(self, ref, point):
		if self.link_doc.GetElement(ref.LinkedElementId).Category.Name in self.fail_cats_list:
			return False
		elif self.link_doc.GetElement(ref.LinkedElementId).GetType().ToString() in self.fail_types_list:
			return False
		elif not self.link_doc.GetElement(ref.LinkedElementId) and not self.link_doc.GetElement(ref.LinkedElementId).get_Geometry(geo_options):
			return False
		elif str(ref.LinkedElementId.IntegerValue) in self.all_link_id_string:
			return False
		else:
			return True


link_doc = UnwrapElement(IN[1]).GetLinkDocument()
if IN[0][0]: 
	fail_cats_list = IN[2][0]
else:
	fail_cats_list = IN[2][1]
fail_types_list = IN[2][2]
all_link_id_list = IN[4][2]
all_link_id_string = string.join(all_link_id_list,",")
param_of_id_on_link = IN[4][0] # "АБН_ID_of_link_element"
param_of_volum_test_on_link = IN[4][1] # АБН_elem_volume_test
param_of_highite = IN[4][3] # АБН_elem_volume_test

fam_path = IN[3][0]
material = tolist(IN[3][1])
isVoid = tolist(False)
subcat = tolist(IN[3][2])
volum_limit = IN[3][3]

sel1 = uidoc.Selection
ot2 = Selection.ObjectType.LinkedElement
el_ref = sel1.PickObjects(Selection.ObjectType.LinkedElement,CustomISelectionFilterList(link_doc,fail_cats_list,fail_types_list,all_link_id_string), "Select the linked elements and press Finish.")
references_clear_list = {ref.LinkedElementId:ref for ref in el_ref}
sel1.Dispose()
del el_ref,sel1
gc.collect()
#endregion
out1 = references_clear_list.values() # референсы 
volume_test = []
def parim_writer(new_elem_id,link_elem_id):
	new_element = doc.GetElement(new_elem_id)
	old_element = link_doc.GetElement(link_elem_id)
	new_element.LookupParameter(param_of_id_on_link).Set(str(link_elem_id.IntegerValue))
	if old_element.get_Parameter(BuiltInParameter.HOST_VOLUME_COMPUTED):
		#old_volume = Math.Round(old_element.Parameter[BuiltInParameter.HOST_VOLUME_COMPUTED].AsDouble() / 35.3147,3)#.ToString("N3")
		old_volume = Math.Round(old_element.get_Parameter(BuiltInParameter.HOST_VOLUME_COMPUTED).AsDouble() ,3)#.ToString("N3")
		new_volume = Math.Round(new_element.get_Parameter(BuiltInParameter.HOST_VOLUME_COMPUTED).AsDouble() ,3)#.ToString("N3")
		#new_volume = Math.Round(new_element.LookupParameter("Объем").AsDouble() ,3)#.ToString("N3")
		volume_compare = old_volume - new_volume# / 35.3147
		new_element.LookupParameter(param_of_volum_test_on_link).Set((old_volume / 35.3147).ToString("N3"))
		if volume_compare != 0:
			volume_compare = volume_compare / 35.3147
		volume_test.append(((old_volume,new_volume),volume_compare,volum_limit))	
		if volume_compare < -volum_limit or volume_compare > volum_limit:#volume_compare != 0 and volume_compare > 0.1 or volume_compare < -0.1:
			new_element.LookupParameter(param_of_highite).Set(1)
		else:
			new_element.LookupParameter(param_of_highite).Set(0)

#region Копируем элементы, за исключением контекста
if IN[0][0]: 


	#link = UnwrapElement(IN[3])
	LinkDoc = link_doc
	el_ref_of_link_elem = out1
	
	cats = doc.Settings.Categories
	cats_id = [i.Id for i in cats]
	
	def copy_elements(id_elem_from_link):
		eList = List[ElementId]()
		#id_elem_from_link = el_ref.LinkedElementId
		eList.Add(id_elem_from_link)
		new_element_id_list = None
		if LinkDoc.GetElement(id_elem_from_link).GetType().ToString() == "Autodesk.Revit.DB.FamilyInstance" and LinkDoc.GetElement(id_elem_from_link).Symbol.Family.IsInPlace:
			inplace_ref_list.append(id_elem_from_link)
		try:
			new_element_id_list = ElementTransformUtils.CopyElements(LinkDoc, eList, doc, transform, copy_past_opt)
		except:
			fail_list.append(id_elem_from_link)
		if new_element_id_list != None:
			new_elem_id = new_element_id_list[0]
			new_element = doc.GetElement(new_elem_id)
			if new_element:
				doc.Regenerate()
				parim_writer(new_elem_id, id_elem_from_link)
		return new_elem_id
	
	copy_past_opt = CopyPasteOptions()
	copy_past_opt.SetDuplicateTypeNamesHandler(iDuplicatesOptoins())
	geo_options = Options()
	geo_options.ComputeReferences = True
	geo_options.IncludeNonVisibleObjects = True
	transform = None
	
	new_elements_id = []
	inplace_ref_list = []
	
	#TransactionManager.Instance.EnsureInTransaction(doc)
	elems_iList = List[ElementId]()
	[inplace_ref_list.append(r1) if LinkDoc.GetElement(r1.LinkedElementId).GetType().ToString() == "Autodesk.Revit.DB.FamilyInstance" and LinkDoc.GetElement(r1.LinkedElementId).Symbol.Family.IsInPlace else elems_iList.Add(r1.LinkedElementId) for r1 in el_ref_of_link_elem]
	
	if len(elems_iList) > 0:
		TransactionManager.Instance.EnsureInTransaction(doc)
		new_elements_id = [copy_elements(id_elem_from_link) for id_elem_from_link in elems_iList]
		[parim_writer(new_elem_id,link_elem_id) for new_elem_id, link_elem_id in zip(new_elements_id, elems_iList) if doc.GetElement(new_elem_id) and doc.GetElement(new_elem_id).LookupParameter(param_of_id_on_link) != None]
		TransactionManager.Instance.TransactionTaskDone()
	
	out2 = inplace_ref_list
	
	del el_ref_of_link_elem,new_elements_id,inplace_ref_list
	gc.collect()
#endregion
	#region Копируем контекст
	if out2:
		el_ref_of_link_elem = out2
		new_elements_list = []
		fail_list = []

		TransactionManager.Instance.EnsureInTransaction(doc)
		for el_ref in el_ref_of_link_elem:
			eList = List[ElementId]()
			id_elem_from_link = el_ref.LinkedElementId
			eList.Add(id_elem_from_link)
			new_element_id_list = None
			try:
				new_element_id_list = ElementTransformUtils.CopyElements(LinkDoc, eList, doc, transform, copy_past_opt)
			except Exception:
				fail_list.append(LinkDoc.GetElement(id_elem_from_link))
			if new_element_id_list != None:
				new_elem_id = new_element_id_list[0]
				new_element = doc.GetElement(new_elem_id)
				if new_element != None and new_element.LookupParameter(param_of_id_on_link) != None:
					doc.Regenerate()
					parim_writer(new_elem_id,id_elem_from_link)
		TransactionManager.Instance.TransactionTaskDone()

		OUT = volume_test,fail_list
	#endregion

#region ----------Создаём новые семейства Based on Dimitar Venkov famaly instance creator
elif not IN[0][0]:

	#clr.AddReference("RevitNodes")
	#import Revit
	#clr.ImportExtensions(Revit.Elements)
	#clr.ImportExtensions(Revit.GeometryConversion)

	def output1(l1):
		if len(l1) == 1: return l1[0]
		else: return l1
	
	def PadLists(lists):
		len1 = len(lists[0])
		for i in xrange(1,len(lists)):
			len2 = len(lists[i])
			if len2 == len1 : continue
			elif len2 > len1: lists[i] = lists[i][:len1]
			else : lists[i].extend(repeat(lists[i][-1],len1 - len2))
		return lists
	
	class FamOpt1(IFamilyLoadOptions):
		def __init__(self):
			pass
		def OnFamilyFound(self,familyInUse, overwriteParameterValues):
			return True
		def OnSharedFamilyFound(self,familyInUse, source, overwriteParameterValues):
			return True
	#region-----------------------------получение геометрии---------------	
	refs = out1
	elements = [link_doc.GetElement(ref.LinkedElementId) for ref in refs]	
	geo_options = Options()
	geo_options.ComputeReferences = True
	geo_options.IncludeNonVisibleObjects = True	
	e_geoms = {}
	volume_test = []
	def get_geometys(element):
		if element.get_Geometry(geo_options):
			key = (element.Category.Name, element.Id.IntegerValue)
			e_geoms[key] = []
			for geometry_inst in element.get_Geometry(geo_options):
				test_solid = []
				if geometry_inst.GetType() == Autodesk.Revit.DB.GeometryInstance:
					for geometry in geometry_inst.SymbolGeometry:
						if geometry.GetType() == Autodesk.Revit.DB.Solid and geometry.Volume > 0:
							try:
								e_geoms[key].append(geometry)
								volume_test.append(geometry.Volume)
							except: pass
				else:
					if geometry_inst.GetType() == Autodesk.Revit.DB.Solid and geometry_inst.Volume > 0:
						try:
							e_geoms[key].append(geometry_inst)
							volume_test.append(geometry.Volume)
						except: pass
	[get_geometys(element) for element in elements]

	cats_and_solids = [(items[0], items[1]) for items in e_geoms.items() if items[1]]
	#endregion
	geom = []
	names = []
	category = []
	old_ids_list = []
	for cs in cats_and_solids:
		geom.append(cs[1])
		names.append(cs[0][0] + "_ID_" + str(cs[0][1]))
		category.append(cs[0][0])
		old_ids_list.append(ElementId(int(cs[0][1])))

	units = doc.GetUnits().GetFormatOptions(UnitType.UT_Length).DisplayUnits
	factor = UnitUtils.ConvertToInternalUnits(1,units)
	acceptable_views = ("ThreeD", "FloorPlan", "EngineeringPlan", "CeilingPlan", "Elevation", "Section")
	origin = XYZ(0,0,0)
	str_typ = StructuralType.NonStructural
	t1 = TransactionManager.Instance
	temp_path = System.IO.Path.GetTempPath()
	opt1 = Options()
	opt1.ComputeReferences = True
	SaveAsOpt = SaveAsOptions()
	SaveAsOpt.OverwriteExistingFile = True
	
	def FindMat(doc,mat1):
		mat_fec = FilteredElementCollector(doc).OfClass(Material)
		for m in mat_fec:
			if m.Name == mat1:
				fam_mat = m
				break
		return fam_mat

	def NewForm_background(geom, name1, cat1, isVoid1, mat1, subcat1, id_elem_from_link):
		enable_mat = False if mat1 is None else True
		enable_subcat = False if subcat1 is None else True
		TransactionManager.ForceCloseTransaction(t1)
		famdoc = doc.Application.NewFamilyDocument(fam_path)
		message = None
		temp_path = System.IO.Path.GetTempPath()
		sat_path = "%s%s.sat" % (temp_path, name1)
		t1.EnsureInTransaction(famdoc)
		if message is None:
			try:
				save_path = "%s%s.rfa" % (temp_path, name1)
				try: #set the category
					fam_cat = famdoc.Settings.Categories.get_Item(cat1.Name)
					famdoc.OwnerFamily.FamilyCategory = fam_cat
				except:
					fam_cat = famdoc.Settings.Categories.get_Item("Каркас несущий")
					famdoc.OwnerFamily.FamilyCategory = fam_cat
				if not isinstance(geom, list):
					geom = [geom]
				for s1 in geom:
					if Math.Round(s1.Volume,3) != 0:
						s2 = FreeFormElement.Create(famdoc,s1)
						#volume_test.append(s1.Volume)
						if s1.Volume < 0:
							void_par = s2.get_Parameter(BuiltInParameter.ELEMENT_IS_CUTTING).Set(1)
							void_par2 = famdoc.OwnerFamily.get_Parameter(BuiltInParameter.FAMILY_ALLOW_CUT_WITH_VOIDS).Set(1)
						else: #voids do not have a material values or a sub-cateogry
							if enable_mat:
								try:
									fam_mat = FindMat(famdoc,mat1)
									mat_par = s2.get_Parameter(BuiltInParameter.MATERIAL_ID_PARAM).Set(fam_mat.Id)
								except: pass
							if enable_subcat: #create and assign the sub-category:
								try:
									current_fam_cat = famdoc.OwnerFamily.FamilyCategory
									new_subcat = famdoc.Settings.Categories.NewSubcategory(current_fam_cat, subcat1)
									s2.Subcategory = new_subcat
								except: pass
				TransactionManager.ForceCloseTransaction(t1)
				famdoc.SaveAs(save_path, SaveAsOpt)
				family1 = famdoc.LoadFamily(doc, FamOpt1() )
				famdoc.Close(False)
				System.IO.File.Delete(save_path)
				symbols = family1.GetFamilySymbolIds().GetEnumerator()
				symbols.MoveNext()
				symbol1 = doc.GetElement(symbols.Current)
				t1.EnsureInTransaction(doc)
				if not symbol1.IsActive: symbol1.Activate()
				inst1 = doc.Create.NewFamilyInstance(origin, symbol1, str_typ)
				if inst1 != None and inst1.LookupParameter(param_of_id_on_link) != None and inst1.get_Parameter(BuiltInParameter.HOST_VOLUME_COMPUTED):
					doc.Regenerate()
					parim_writer(inst1.Id,id_elem_from_link)
				TransactionManager.ForceCloseTransaction(t1)
				return inst1.ToDSType(False), family1.ToDSType(False)
			except:
				message = (traceback.format_exc(),"")
				return message
		else: return message

	if len(geom) == len(names) == len(category) == len(isVoid) == len(material) == len(subcat):
		return1 = [NewForm_background(g, ns, c, i, ml, s, i) for g, ns, c, i, ml, s, i in zip(geom, names, category, isVoid, material, subcat, old_ids_list)]
	elif len(geom) == len(names) == len(category):
		padded = PadLists([geom, isVoid, material, subcat])
		p_isVoid, p_material, p_subcat = padded[1], padded[2], padded[3]
		return1 = map(NewForm_background, geom, names, category, p_isVoid, p_material, p_subcat, old_ids_list)
	else: return1 = [("Make sure that each geometry \n object has a unique family name.", "")]

	OUT = geom,return1,volume_test
	opt1.Dispose()
	SaveAsOpt.Dispose()
	gc.collect()
#endregion
OUT = volume_test
# ----------------------------------------
список_категорий_2 = StringInput("Части, Стены, Перекрытия, Несущие колонны, Каркас несущий")
перезапуск = BoolSelector(false)
python_script_собираем_элементы = Python(IN[0]=список_категорий_2, IN[1]=перезапуск)  # "Python Script - Собираем элементы по категориям"
# ---------- python_script_собираем_элементы.python (31 lines) ----------
import clr
clr.AddReference("RevitServices")
import RevitServices
from RevitServices.Persistence import DocumentManager

clr.AddReference('RevitAPI')
from Autodesk.Revit.DB import *

doc = DocumentManager.Instance.CurrentDBDocument
uiapp = DocumentManager.Instance.CurrentUIApplication
uidoc = DocumentManager.Instance.CurrentUIDocument
app = uiapp.Application
cats = doc.Settings.Categories
aview = doc.ActiveView

def fcollector_by_cat_to_id(doc,c_id):
	return FilteredElementCollector(doc).OfCategoryId(c_id).WhereElementIsNotElementType().ToElements()

cats = doc.Settings.Categories
collector = FilteredElementCollector(doc)

cats_string = UnwrapElement(IN[0])

cats_id_name = [(cat.Id,cat.Name) for cat in cats if cat.Name in cats_string]

parts = []
elements = []

[parts.append(fcollector_by_cat_to_id(doc,id_name[0])) if id_name[1] == "Части" else elements.append(fcollector_by_cat_to_id(doc,id_name[0])) for id_name in cats_id_name]

OUT = parts, elements
# ----------------------------------------
flatten = Flatten(python_script_собираем_элементы@L3)
code_block = CodeBlock(parts=flatten, elements=flatten) { parts[0]; elements[1]; }
code_block_2 = CodeBlock(Flor=code_block.out1) { Flor; }
объединить_геометрию_разделить_2 = BoolSelector(true)  # "Объединить геометрию /// Разделить геометрию"
unjoin_filter_colector_by_list_1 = Python(IN[0]=code_block_2, IN[1]=объединить_геометрию_разделить_2)
# ---------- unjoin_filter_colector_by_list_1.python (38 lines) ----------
results = 0
from time import time
tic = time() # время для начала отсчета http://dynamobim.ru/forums/topic/раздутый-файл-dyn-callsitetracedata/#post-8050

if IN[1] == False:
	import clr
	
	clr.AddReference('RevitAPI')
	import Autodesk
	from Autodesk.Revit.DB import *#JoinGeometryUtils
	
	clr.AddReference('RevitServices')
	import RevitServices
	from RevitServices.Persistence import DocumentManager
	from RevitServices.Transactions import TransactionManager
	
	#clr.AddReference('System')
	#from System.Collections.Generic import List	
	
	#opt = Options()
	doc = DocumentManager.Instance.CurrentDBDocument
	
	items1 = UnwrapElement(IN[0])
	results = 0
	
	for i in items1:	
		test = JoinGeometryUtils.GetJoinedElements(doc, i)
		if test:
			for t in test:
				TransactionManager.Instance.EnsureInTransaction(doc)
				JoinGeometryUtils.UnjoinGeometry(doc,i,doc.GetElement(t))
				TransactionManager.Instance.TransactionTaskDone()
				results +=1

					
toc = time() # время в конце
time = toc-tic
OUT = "Unjoin elements = "+str(results), "Time in seconds = "+str(time)
# ----------------------------------------
python_script = Python(IN[0]=список_категорий_2)
# ---------- python_script.python (34 lines) ----------
import clr
import System
clr.AddReference('RevitAPI')
from Autodesk.Revit.DB import *
clr.AddReference("RevitNodes")
import Revit
clr.AddReference("RevitServices")
from RevitServices.Persistence import DocumentManager
doc = DocumentManager.Instance.CurrentDBDocument
clr.AddReference('System')
import System
from System.Collections.Generic import List

bics = System.Enum.GetValues(BuiltInCategory)
cdata = []

cats = doc.Settings.Categories
cats_string = UnwrapElement(IN[0])

cats_id_name = [(cat.Id,cat.Name) for cat in cats if cat.Name in cats_string]
cats_id = [cat.Id for cat in cats if cat.Name in cats_string]
"""
build_ilist = List[BuiltInCategory]()
#cats_build_in = [build_ilist.Add(category.Id.IntegerValuefor) for category in cats]#[build_ilist.Add(id.IntegerValuefor) for id[0] in cats_id_name]

#finde_ost = [bic for bic in bics if Revit.Elements.Category.ById(ElementId(bic).IntegerValue).Name in cats_names]

for bic in bics:
	try:
		cdata.append(Revit.Elements.Category.ById(ElementId(bic).IntegerValue).Name)
	except:
		pass
"""
OUT = cats_id
# ----------------------------------------
filter_colector_by_list_1_0 = Python(IN[0]=code_block_2, IN[1]=объединить_геометрию_разделить_2, IN[2]=python_script)
# ---------- filter_colector_by_list_1_0.python (162 lines) ----------
results = 0
from time import time
tic = time() # время для начала отсчета http://dynamobim.ru/forums/topic/раздутый-файл-dyn-callsitetracedata/#post-8050

if IN[1] == True:
	import clr
	
	clr.AddReference('RevitAPI')
	import Autodesk
	from Autodesk.Revit.DB import GeometryInstance, FilteredElementCollector, JoinGeometryUtils, Options, ElementId, ElementIntersectsSolidFilter, BuiltInParameter
	
	clr.AddReference('RevitServices')
	import RevitServices
	from RevitServices.Persistence import DocumentManager
	from RevitServices.Transactions import TransactionManager
	
	clr.AddReference('System')
	from System.Collections.Generic import List
	from System import Math
	
	def flatten_List(a, res=None):
		if res is None:
			res = []
		for i in a:
			if isinstance(a, list):
				flatten_List(i, res)
			else:
				res.append(i)
		return res
	
	
	def join(x,y):
		try:
			JoinGeometryUtils.JoinGeometry(doc,x,y)
			results = 1
		except:
			results = 0
		return results
	
	def join_s(x,y):
		try:
			JoinGeometryUtils.JoinGeometry(doc,x,y)
			JoinGeometryUtils.SwitchJoinOrder(doc,x,y)
			results = 1
		except:
			results = 0
		return results	
	
	opt = Options()
	doc = DocumentManager.Instance.CurrentDBDocument
	
	reset = IN[0]
	items1 = UnwrapElement(IN[0])
	catIdlist = UnwrapElement(IN[2])
	ids = []
	inter = []
	aliter = []
	alliter = []

	geo_options = Options()
	geo_options.ComputeReferences = False
	geo_options.IncludeNonVisibleObjects = False	

	def get_geometys(element):
		if element.get_Geometry(geo_options):
			for geometry_inst in element.get_Geometry(geo_options):
				if geometry_inst.GetType() == Autodesk.Revit.DB.GeometryInstance:
					for geometry in geometry_inst.SymbolGeometry:
						if geometry.GetType() == Autodesk.Revit.DB.Solid and Math.Round(geometry.Volume,3) != 0:
							return geometry
				else:
					if geometry_inst.GetType() == Autodesk.Revit.DB.Solid and Math.Round(geometry_inst.Volume,3) != 0:
						return geometry_inst

	for i in items1:
		ids.append(i.Id)
		
	iids = List[ElementId](ids)

	for i1 in items1:	
		#geomElem = i1.get_Geometry(opt)
		"""
		for geomObj in geomElem:
			ids.append(geomObj.ToString())
			if geomObj.ToString() == "Autodesk.Revit.DB.GeometryInstance":
				gsd = geomObj.GetInstanceGeometry()
				for g in gsd:
					if g != None: 
						geomSolid = g
					else:
						pass
				#results = results + 1
			else:
				geomSolid = geomObj
		iter = []
		"""
		geomSolid = get_geometys(i1)
		if geomSolid != None:
			for ost in catIdlist:
				iter = []
				items = FilteredElementCollector(doc,iids).OfCategoryId(ost).WhereElementIsNotElementType()
				iter.append(items.WherePasses(ElementIntersectsSolidFilter(geomSolid)).ToElements())
				inter = flatten_List(iter)
				for int in inter:
					if int.Id.ToString() == i1.Id.ToString():
						pass
					else:
						TransactionManager.Instance.EnsureInTransaction(doc)
						if JoinGeometryUtils.AreElementsJoined(doc,int,i1):
							pass
						else:
							results += join(int,i1)
							"""
							if int.Category.Name == "Стены" and i1.Category.Name == "Стены":
								if int.get_Parameter(BuiltInParameter.WALL_STRUCTURAL_SIGNIFICANT).AsValueString() == "Да":
									results += join(int,i1)
								elif i1.get_Parameter(BuiltInParameter.WALL_STRUCTURAL_SIGNIFICANT).AsValueString() == "Да":
									results += join(i1,int)
								elif int.Width >= i1.Width:
									results += join(int,i1)
								else:
									results += join(i1,int)
							elif int.Category.Name == "Перекрытия" and int.get_Parameter(BuiltInParameter.FLOOR_PARAM_IS_STRUCTURAL).AsValueString() == "Да":
								if i1.Category.Name == "Перекрытия" and i1.get_Parameter(BuiltInParameter.FLOOR_PARAM_IS_STRUCTURAL).AsValueString() == "Да":
									if int.get_Parameter(BuiltInParameter.FLOOR_ATTR_THICKNESS_PARAM).AsDouble()*304.8 > i1.get_Parameter(BuiltInParameter.FLOOR_ATTR_THICKNESS_PARAM).AsDouble()*304.8:
										results += join(int,i1)
									else:
										results += join(i1,int)
								else:
									results += join(int,i1)
							elif i1.Category.Name == "Перекрытия" and i1.get_Parameter(BuiltInParameter.FLOOR_PARAM_IS_STRUCTURAL).AsValueString() == "Да":
								if int.Category.Name == "Перекрытия" and int.get_Parameter(BuiltInParameter.FLOOR_PARAM_IS_STRUCTURAL).AsValueString() == "Да":
									if int.get_Parameter(BuiltInParameter.FLOOR_ATTR_THICKNESS_PARAM).AsDouble()*304.8 > i1.get_Parameter(BuiltInParameter.FLOOR_ATTR_THICKNESS_PARAM).AsDouble()*304.8:
										results += join(int,i1)
									else:
										results += join(i1,int)
								else:
									results += join(i1,int)
							elif int.Category.Name == "Стены" and i1.Category.Name == "Перекрытия":
								if int.get_Parameter(BuiltInParameter.WALL_STRUCTURAL_SIGNIFICANT).AsValueString() == "Да":
									results += join_s(int,i1)
								else:
									results += join(int,i1)
							elif int.Category.Name == "Перекрытия" and i1.Category.Name == "Стены":
								if i1.get_Parameter(BuiltInParameter.WALL_STRUCTURAL_SIGNIFICANT).AsValueString() == "Да":
									results += join_s(i1,int)
								else:
									results += join(int,i1)
							elif int.Category.Name == "Перекрытия" and i1.Category.Name == "Перекрытия":	
								if int.get_Parameter(BuiltInParameter.FLOOR_ATTR_THICKNESS_PARAM).AsDouble()*304.8 > i1.get_Parameter(BuiltInParameter.FLOOR_ATTR_THICKNESS_PARAM).AsDouble()*304.8:
									results += join(int,i1)
								else:
									results += join(i1,int)
							else:
								results += join(int,i1)
							"""
	
						TransactionManager.Instance.TransactionTaskDone()
					
toc = time() # время в конце
time = toc-tic
OUT = "Join elements = "+str(results), "Time in seconds = "+str(time)
# ----------------------------------------
количество_объединённых = Watch(filter_colector_by_list_1_0)  # "Количество объединённых элементов"
